# Grasshopper definition branching-constrained.gh (Grasshopper 1.0.7)

# ---- group: 1. connect to server
connect = Connect(connect=Button())  # -> status, connections
# ---------- connect: Python ----------
import urllib2, socket
import sys, math, os, json

t_o = 1

if not connect:
    local_file = ghenv.Component.OnPingDocument().FilePath
    if local_file == None:
        status = "Please save your Grasshopper file before connecting to Discover server"
    else:
        file_path = local_file.split("\\")
        file_dir = "\\".join(file_path)#[:-1])
        file_name = file_path[-1].split(".")[0]
        
        print(file_name)
        
        try:
            response = urllib2.urlopen('http://127.0.0.1:5000/api/v1.0/connect/' + urllib2.quote(file_name), timeout=t_o)
            html = response.read()
            result = json.loads(html)
            status = result["status"]
            connections = result["connections"]
        except urllib2.URLError:
            status = "Server not found"
        except socket.timeout:
            status = "Server timed out"
# ---------- end connect ----------
bang = ExplodeTree(Data=simplify(graft(connect.connections)))  # -> Branch0, Branch1
panel = Panel(connect.status)

# ---- group: 2. get inputs from server
file = ReadFile(File=bang.Branch0, PerLineParse=True)
get_inputs = GetInputs(connection=file)  # -> out, inputs
# ---------- get_inputs: Python ----------
import time, json, urllib2, socket

t_o = 1

try:
    response = urllib2.urlopen('http://127.0.0.1:5000/api/v1.0/get_inputs/', timeout=t_o)# + urllib2.quote(file_dir))
    html = response.read()
    inputs = json.loads(html)
    print "Received inputs from server"
except urllib2.URLError:
    inputs = []
    print "Could not connect to server"
except socket.timeout:
    inputs = []
    print "Server timed out"

#print inputs
# ---------- end get_inputs ----------
python = GhPythonScript(x=get_inputs.inputs)  # -> a
# ---------- python: Python ----------
a = x
# ---------- end python ----------

# ---- group: 4. capture screenshot
file_2 = ReadFile(File=bang.Branch1, PerLineParse=True)
screenshot = Screenshot(connection=file_2)  # -> out; inputs connection: list
# ---------- screenshot: Python ----------
import time, json, urllib2, socket
import Rhino
import System
import scriptcontext

t_o = 1

def make_view(view_name, views):
        new_view = views.Add(view_name, Rhino.Display.DefinedViewportProjection.Perspective, System.Drawing.Rectangle(0,0,800, 600), True)
        new_vp = new_view.MainViewport
        new_vp.WorldAxesVisible = False
        new_vp.ZoomExtents()
        return new_view

def capture_screenshot():
    views = Rhino.RhinoDoc.ActiveDoc.Views
    view_name = "Discover"
    
    view_list = views.GetViewList(True, True)
    view_names = [vp.MainViewport.Name for vp in view_list]
    
    if view_name not in view_names:
        view = make_view(view_name, views)
    else:
        view = view_list[view_names.index(view_name)]
    
    bitmap = view.CaptureToBitmap(False, False, False)
    
    file_path = ghenv.Component.OnPingDocument().FilePath.split("\\")
    
    req = urllib2.Request('http://127.0.0.1:5000/api/v1.0/get_ss_path/')
    req.add_header('Content-Type', 'application/json')
    
    response = urllib2.urlopen(req, timeout=t_o)
    html = response.read()
    result = json.loads(html)
    
    if result["status"] == "success":
        path = result["path"]
    
    save_dir = ".".join([path, "png"])
    
    print "Saved screenshot to", save_dir
    
    bitmap.Save(save_dir)

def ping_server():
    try:
        req = urllib2.Request('http://127.0.0.1:5000/api/v1.0/ss_done/')
        req.add_header('Content-Type', 'application/json')
        
        response = urllib2.urlopen(req, timeout=t_o)
        html = response.read()
        result = json.loads(html)
    
        print result["status"]
    
    except urllib2.URLError:
        print "Could not connect to server"

try:
    req = urllib2.Request('http://127.0.0.1:5000/api/v1.0/job_running/')
    req.add_header('Content-Type', 'application/json')
    
    response = urllib2.urlopen(req, timeout=t_o)
    html = response.read()
    result = json.loads(html)
    
    if result:
        capture_screenshot()
        ping_server()
    else:
        print "No job running"
        
except urllib2.URLError:
    print "Could not connect to server"
except socket.timeout:
    print "Server timed out"
# ---------- end screenshot ----------
panel_2 = Panel(screenshot)

# ----
genes = GenePool(
    Decimals=0,
    Maximum=2,
    Minimum=0,
    Value=[0.1480393951, 0.7712121684, 0.1112466148, 0.5832830382, 0.009789849636, 1.350660821, 1.58505699, 0.4446274966, 0.07651608534, 0.7343137752, 0.4409568573, 0.9802357512, 0.1328910869, 1.826282953, 0.760141103, 0.9285441483, 0.4076041395, 1.584034186, 0.8796410984, 0.2161452008, 0.004494436087, 0.3138407768, 0.3065494589, 0.4968771294, 1.675049565])
pt = ConstructPoint(XCoordinate=0, YCoordinate=0, ZCoordinate=0)
round = Round(Number=python)  # -> Nearest, Floor, Ceiling
python_2 = PythonScript(start=pt, params=round.Floor)  # -> out, lines; inputs params: list
# ---------- python_2: Python ----------
import rhinoscriptsyntax as rs
import random

lines = []
stack = []

spread = .5
height = .5

iter = len(params)

def grow(dir):
    if len(params) <= 0:
        return None
    
    point = stack.pop(0)
    if point.Z > 3:
        return None
    
    param = params.pop()

    if param == 2:
        for m in [-1,1]:
            m += (random.random()-0.5) * 0.5
            p = rs.AddPoint(point.X + m * spread * dir[0], point.Y + m * spread * dir[1], point.Z + height)
            stack.append(rs.coerce3dpoint(p))
            lines.append(rs.AddLine(point, p))
            grow(list(reversed(dir)))
    elif param == 1:
        z_val = 1 + ((random.random()-0.5) * 0.5)
        p1 = rs.AddPoint(point.X, point.Y, point.Z+z_val)
        stack.append(rs.coerce3dpoint(p1))
        lines.append(rs.AddLine(point, p1))
        grow(dir)

stack.append(rs.coerce3dpoint(start))

grow([0,1])
# ---------- end python_2 ----------
end = EndPoints(Curve=python_2.lines)  # -> Start, End
merge = Merge(Data1=flatten(pt), Data2=flatten(end.Start), Data3=flatten(end.End))
cullpt = CullDuplicates(Points=merge, Tolerance=0.1, CullMode=3)  # -> Points, Indices, Valence
pt_2 = ConstructPoint(XCoordinate=0, YCoordinate=0, ZCoordinate=Slider(3, range=0..10))
pdecon = Deconstruct(Point=cullpt.Points)  # -> XComponent, YComponent, ZComponent
sph = Sphere(Base=pt_2, Radius=Slider(0.9, range=0..1))
bnd = Bounds(Numbers=pdecon.XComponent)
bnd_2 = Bounds(Numbers=pdecon.YComponent)
bnd_3 = Bounds(Numbers=pdecon.ZComponent)
brepinc = PointInBrep(Brep=sph, Point=cullpt.Points, Strict=False)
preview = CustomPreview(Geometry=sph, Material=ColourSwatch(SwatchColor=RGBA(255, 255, 255, 119)))
dedomain = DeconstructDomain(Domain=bnd)  # -> Start, End
dedomain_2 = DeconstructDomain(Domain=bnd_2)  # -> Start, End
dedomain_3 = DeconstructDomain(Domain=bnd_3)  # -> Start, End
subtraction = Subtraction(A=dedomain.Start, B=dedomain.End)
subtraction_2 = Subtraction(A=dedomain_2.Start, B=dedomain_2.End)
subtraction_3 = Subtraction(A=dedomain_3.Start, B=dedomain_3.End)
dispatch = Dispatch(List=cullpt.Points, DispatchPattern=brepinc)  # -> ListA, ListB
ma = MassAddition(Input=brepinc)  # -> Result, PartialResults
abs = Absolute(Value=subtraction)
abs_2 = Absolute(Value=subtraction_2)
abs_3 = Absolute(Value=subtraction_3)
dots = DotDisplay(Point=dispatch.ListA, Colour=ColourSwatch(SwatchColor=RGB(255, 0, 0)), Size=".1")

# ---- group: 3. send outputs to server
merge_2 = Merge(Data1=flatten(abs), Data2=flatten(abs_2), Data3=flatten(abs_3), Data4=flatten(ma.Result))
send_outputs = SendOutputs(outputs=merge_2)  # -> out; inputs outputs: list
# ---------- send_outputs: Python ----------
import time, json, urllib2, socket

t_o = 1

#try:
#    response = urllib2.urlopen('http://127.0.0.1:5000/api/v1.0/set_outputs/' + urllib2.quote(file_dir))
#    html = response.read()
#    inputs = json.loads(html)
#except urllib2.URLError:
#    inputs = []
#    print "could not connect to server"

try:
    req = urllib2.Request('http://127.0.0.1:5000/api/v1.0/set_outputs/')
    req.add_header('Content-Type', 'application/json')
    
    response = urllib2.urlopen(req, json.dumps(outputs), timeout=t_o)
    html = response.read()
    result = json.loads(html)

    print result["status"]

except urllib2.URLError:
    print "could not connect to server"
except socket.timeout:
    print "Server timed out"
# ---------- end send_outputs ----------
panel_3 = Panel(send_outputs)
