# Grasshopper definition grid.gh (Grasshopper 1.0.7)

# ---- group: 1. connect to server
connect = Connect(connect=Button())  # -> status, connections
# ---------- connect: Python ----------
import urllib2, socket
import sys, math, os, json

t_o = 1

if not connect:
    local_file = ghenv.Component.OnPingDocument().FilePath
    if local_file == None:
        status = "Please save your Grasshopper file before connecting to Discover server"
    else:
        file_path = local_file.split("\\")
        file_dir = "\\".join(file_path)#[:-1])
        file_name = file_path[-1].split(".")[0]
        
        print(file_name)
        
        try:
            response = urllib2.urlopen('http://127.0.0.1:5000/api/v1.0/connect/' + urllib2.quote(file_name), timeout=t_o)
            html = response.read()
            result = json.loads(html)
            status = result["status"]
            connections = result["connections"]
        except urllib2.URLError:
            status = "Server not found"
        except socket.timeout:
            status = "Server timed out"
# ---------- end connect ----------
bang = ExplodeTree(Data=simplify(graft(connect.connections)))  # -> Branch0, Branch1
panel = Panel(connect.status)

# ---- group: 2. get inputs from server
file = ReadFile(File=bang.Branch0, PerLineParse=True)
get_inputs = GetInputs(connection=file)  # -> out, inputs
# ---------- get_inputs: Python ----------
import time, json, urllib2, socket

t_o = 1

try:
    response = urllib2.urlopen('http://127.0.0.1:5000/api/v1.0/get_inputs/', timeout=t_o)# + urllib2.quote(file_dir))
    html = response.read()
    inputs = json.loads(html)
    print "Received inputs from server"
except urllib2.URLError:
    inputs = []
    print "Could not connect to server"
except socket.timeout:
    inputs = []
    print "Server timed out"

#print inputs
# ---------- end get_inputs ----------
python = GhPythonScript(x=get_inputs.inputs)  # -> a
# ---------- python: Python ----------
a = x
# ---------- end python ----------

# ---- group: 4. capture screenshot
file_2 = ReadFile(File=bang.Branch1, PerLineParse=True)
screenshot = Screenshot(connection=file_2)  # -> out; inputs connection: list
# ---------- screenshot: Python ----------
import time, json, urllib2, socket
import Rhino
import System
import scriptcontext

t_o = 1

def make_view(view_name, views):
        new_view = views.Add(view_name, Rhino.Display.DefinedViewportProjection.Perspective, System.Drawing.Rectangle(0,0,800, 600), True)
        new_vp = new_view.MainViewport
        new_vp.WorldAxesVisible = False
        new_vp.ZoomExtents()
        return new_view

def capture_screenshot():
    views = Rhino.RhinoDoc.ActiveDoc.Views
    view_name = "Discover"
    
    view_list = views.GetViewList(True, True)
    view_names = [vp.MainViewport.Name for vp in view_list]
    
    if view_name not in view_names:
        view = make_view(view_name, views)
    else:
        view = view_list[view_names.index(view_name)]
    
    bitmap = view.CaptureToBitmap(False, False, False)
    
    file_path = ghenv.Component.OnPingDocument().FilePath.split("\\")
    
    req = urllib2.Request('http://127.0.0.1:5000/api/v1.0/get_ss_path/')
    req.add_header('Content-Type', 'application/json')
    
    response = urllib2.urlopen(req, timeout=t_o)
    html = response.read()
    result = json.loads(html)
    
    if result["status"] == "success":
        path = result["path"]
    
    save_dir = ".".join([path, "png"])
    
    print "Saved screenshot to", save_dir
    
    bitmap.Save(save_dir)

def ping_server():
    try:
        req = urllib2.Request('http://127.0.0.1:5000/api/v1.0/ss_done/')
        req.add_header('Content-Type', 'application/json')
        
        response = urllib2.urlopen(req, timeout=t_o)
        html = response.read()
        result = json.loads(html)
    
        print result["status"]
    
    except urllib2.URLError:
        print "Could not connect to server"

try:
    req = urllib2.Request('http://127.0.0.1:5000/api/v1.0/job_running/')
    req.add_header('Content-Type', 'application/json')
    
    response = urllib2.urlopen(req, timeout=t_o)
    html = response.read()
    result = json.loads(html)
    
    if result:
        capture_screenshot()
        ping_server()
    else:
        print "No job running"
        
except urllib2.URLError:
    print "Could not connect to server"
except socket.timeout:
    print "Server timed out"
# ---------- end screenshot ----------
panel_2 = Panel(screenshot)

# ---- group: manual inputs
genes = GenePool(
    Decimals=2,
    Maximum=2.99,
    Minimum=0,
    Value=[0.1220258478, 0.2622682871, 1.882439865, 1.099572845, 0.8894917986, 1.393539092, 0.6604541749, 0.08817211659, 0.2905419103, 2.929504066, 2.222704386, 2.322042178, 1.759427169, 1.016563543, 0.02374773407, 1.17013253, 1.674641398, 2.958922725, 0.09510085215, 2.217230817, 2.302600101, 0.9492934207, 1.799687171, 1.188400383, 0.3184272651])
round = Round(Number=genes)  # -> Nearest, Floor, Ceiling

# ----
number_slider = Slider(5, range=0..10)
int = Integer(python)
series = Series(Start=0, Step=1, Count=number_slider)
pt = ConstructPoint(XCoordinate=0, YCoordinate=0, ZCoordinate=0)
X = UnitX(Factor=series)
Y = UnitY(Factor=series)
move = Move(Geometry=pt, Motion=X)  # -> Geometry, Transform
gradient = Gradient(
    LowerLimit="0",
    UpperLimit="2",
    Parameter=int,
    stops=[0: RGB(234, 38, 0), 0.25: RGB(234, 126, 0), 0.5: RGB(254, 244, 84), 0.75: RGB(173, 203, 249), 1: RGB(75, 107, 169)])
division = Division(A=number_slider, B=Slider(2.5, range=0..10))
move_2 = Move(Geometry=graft(move.Geometry), Motion=Y)  # -> flatten(Geometry), Transform
pt_2 = ConstructPoint(XCoordinate=division, YCoordinate=division, ZCoordinate=0)
dist = Distance(PointA=move_2.Geometry, PointB=pt_2)
dots = DotDisplay(Point=move_2.Geometry, Colour=gradient, Size=Slider(0.4, range=0..1))
subtraction = Subtraction(A=int, B=dist)
abs = Absolute(Value=subtraction)
ma = MassAddition(Input=abs)  # -> Result, PartialResults

# ---- group: 3. send outputs to server
merge = Merge(Data1=flatten(ma.Result))
send_outputs = SendOutputs(outputs=merge)  # -> out; inputs outputs: list
# ---------- send_outputs: Python ----------
import time, json, urllib2, socket

t_o = 1

#try:
#    response = urllib2.urlopen('http://127.0.0.1:5000/api/v1.0/set_outputs/' + urllib2.quote(file_dir))
#    html = response.read()
#    inputs = json.loads(html)
#except urllib2.URLError:
#    inputs = []
#    print "could not connect to server"

try:
    req = urllib2.Request('http://127.0.0.1:5000/api/v1.0/set_outputs/')
    req.add_header('Content-Type', 'application/json')
    
    response = urllib2.urlopen(req, json.dumps(outputs), timeout=t_o)
    html = response.read()
    result = json.loads(html)

    print result["status"]

except urllib2.URLError:
    print "could not connect to server"
except socket.timeout:
    print "Server timed out"
# ---------- end send_outputs ----------
panel_3 = Panel(send_outputs)
