# Grasshopper definition pill-so.gh (Grasshopper 1.0.7)

# ---- group: 1. connect to server
connect = Connect(connect=Button())  # -> status, connections
# ---------- connect: Python ----------
import urllib2, socket
import sys, math, os, json

t_o = 1

if not connect:
    local_file = ghenv.Component.OnPingDocument().FilePath
    if local_file == None:
        status = "Please save your Grasshopper file before connecting to Discover server"
    else:
        file_path = local_file.split("\\")
        file_dir = "\\".join(file_path)#[:-1])
        file_name = file_path[-1].split(".")[0]
        
        print(file_name)
        
        try:
            response = urllib2.urlopen('http://127.0.0.1:5000/api/v1.0/connect/' + urllib2.quote(file_name), timeout=t_o)
            html = response.read()
            result = json.loads(html)
            status = result["status"]
            connections = result["connections"]
        except urllib2.URLError:
            status = "Server not found"
        except socket.timeout:
            status = "Server timed out"
# ---------- end connect ----------
bang = ExplodeTree(Data=simplify(graft(connect.connections)))  # -> Branch0, Branch1
panel = Panel(connect.status)

# ---- group: 2. get inputs from server
file = ReadFile(File=bang.Branch0, PerLineParse=True)
get_inputs = GetInputs(connection=file)  # -> out, inputs
# ---------- get_inputs: Python ----------
import time, json, urllib2, socket

t_o = 1

try:
    response = urllib2.urlopen('http://127.0.0.1:5000/api/v1.0/get_inputs/', timeout=t_o)# + urllib2.quote(file_dir))
    html = response.read()
    inputs = json.loads(html)
    print "Received inputs from server"
except urllib2.URLError:
    inputs = []
    print "Could not connect to server"
except socket.timeout:
    inputs = []
    print "Server timed out"

#print inputs
# ---------- end get_inputs ----------
python = GhPythonScript(x=get_inputs.inputs)  # -> a
# ---------- python: Python ----------
a = x
# ---------- end python ----------
bang_2 = ExplodeTree(Data=simplify(graft(python)))  # -> _00000, Branch1, Branch2

# ---- group: 4. capture screenshot
file_2 = ReadFile(File=bang.Branch1, PerLineParse=True)
screenshot = Screenshot(connection=file_2)  # -> out; inputs connection: list
# ---------- screenshot: Python ----------
import time, json, urllib2, socket
import Rhino
import System
import scriptcontext

t_o = 1

def make_view(view_name, views):
        new_view = views.Add(view_name, Rhino.Display.DefinedViewportProjection.Perspective, System.Drawing.Rectangle(0,0,800, 600), True)
        new_vp = new_view.MainViewport
        new_vp.WorldAxesVisible = False
        new_vp.ZoomExtents()
        return new_view

def capture_screenshot():
    views = Rhino.RhinoDoc.ActiveDoc.Views
    view_name = "Discover"
    
    view_list = views.GetViewList(True, True)
    view_names = [vp.MainViewport.Name for vp in view_list]
    
    if view_name not in view_names:
        view = make_view(view_name, views)
    else:
        view = view_list[view_names.index(view_name)]
    
    bitmap = view.CaptureToBitmap(False, False, False)
    
    file_path = ghenv.Component.OnPingDocument().FilePath.split("\\")
    
    req = urllib2.Request('http://127.0.0.1:5000/api/v1.0/get_ss_path/')
    req.add_header('Content-Type', 'application/json')
    
    response = urllib2.urlopen(req, timeout=t_o)
    html = response.read()
    result = json.loads(html)
    
    if result["status"] == "success":
        path = result["path"]
    
    save_dir = ".".join([path, "png"])
    
    print "Saved screenshot to", save_dir
    
    bitmap.Save(save_dir)

def ping_server():
    try:
        req = urllib2.Request('http://127.0.0.1:5000/api/v1.0/ss_done/')
        req.add_header('Content-Type', 'application/json')
        
        response = urllib2.urlopen(req, timeout=t_o)
        html = response.read()
        result = json.loads(html)
    
        print result["status"]
    
    except urllib2.URLError:
        print "Could not connect to server"

try:
    req = urllib2.Request('http://127.0.0.1:5000/api/v1.0/job_running/')
    req.add_header('Content-Type', 'application/json')
    
    response = urllib2.urlopen(req, timeout=t_o)
    html = response.read()
    result = json.loads(html)
    
    if result:
        capture_screenshot()
        ping_server()
    else:
        print "No job running"
        
except urllib2.URLError:
    print "Could not connect to server"
except socket.timeout:
    print "Server timed out"
# ---------- end screenshot ----------
panel_2 = Panel(screenshot)

# ----
geo = Geometry(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)
cp = ControlPoints(Curve=geo)  # -> Points, Weights, Knots
X = UnitX(Factor=bang_2._00000)
X_2 = UnitX(Factor=bang_2.Branch1)
X_3 = UnitX(Factor=bang_2.Branch2)
split = SplitList(List=cp.Points, Index=Slider(1, range=0..1))  # -> ListA, ListB
split_2 = SplitList(List=split.ListB, Index=Slider(3, range=0..10))  # -> ListA, ListB
move = Move(Geometry=split.ListA, Motion=X)  # -> Geometry, Transform
move_2 = Move(Geometry=split_2.ListA, Motion=X_2)  # -> Geometry, Transform
move_3 = Move(Geometry=split_2.ListB, Motion=X_3)  # -> Geometry, Transform
merge = Merge(Data1=flatten(move.Geometry), Data2=flatten(move_2.Geometry), Data3=flatten(move_3.Geometry))
end = EndPoints(Curve=geo)  # -> Start, End
ln = Line(StartPoint=end.Start, EndPoint=end.End)
nurbcrv = NurbsCurve(Points=merge, Weights=cp.Weights, Knots=cp.Knots)  # -> Curve, Length, Domain
revsrf = Revolution(Curve=nurbcrv.Curve, Axis=ln, Domain=Domain(0, 6.283185307))
cap = CapHoles(Brep=revsrf)
volume = Volume(Geometry=cap)  # -> Volume, Centroid
area = Area(Geometry=cap)  # -> Area, Centroid
division = Division(A=area.Area, B=volume.Volume)

# ---- group: 3. send outputs to server
merge_2 = Merge(Data1=flatten(division))
send_outputs = SendOutputs(outputs=merge_2)  # -> out; inputs outputs: list
# ---------- send_outputs: Python ----------
import time, json, urllib2, socket

t_o = 1

#try:
#    response = urllib2.urlopen('http://127.0.0.1:5000/api/v1.0/set_outputs/' + urllib2.quote(file_dir))
#    html = response.read()
#    inputs = json.loads(html)
#except urllib2.URLError:
#    inputs = []
#    print "could not connect to server"

try:
    req = urllib2.Request('http://127.0.0.1:5000/api/v1.0/set_outputs/')
    req.add_header('Content-Type', 'application/json')
    
    response = urllib2.urlopen(req, json.dumps(outputs), timeout=t_o)
    html = response.read()
    result = json.loads(html)

    print result["status"]

except urllib2.URLError:
    print "could not connect to server"
except socket.timeout:
    print "Server timed out"
# ---------- end send_outputs ----------
panel_3 = Panel(send_outputs)
