# Grasshopper definition pill-start.gh (Grasshopper 1.0.7)

genes = GenePool(Decimals=2, Maximum=5, Minimum=0, Value=[0, 5, 0])
geo = Geometry(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)
bang = ExplodeTree(Data=simplify(graft(genes)))  # -> Branch0, Branch1, Branch2
cp = ControlPoints(Curve=geo)  # -> Points, Weights, Knots
X = UnitX(Factor=bang.Branch2)
X_2 = UnitX(Factor=bang.Branch0)
X_3 = UnitX(Factor=bang.Branch1)
split = SplitList(List=cp.Points, Index=Slider(1, range=0..1))  # -> ListA, ListB
split_2 = SplitList(List=split.ListB, Index=Slider(3, range=0..10))  # -> ListA, ListB
move = Move(Geometry=split.ListA, Motion=X_2)  # -> Geometry, Transform
move_2 = Move(Geometry=split_2.ListA, Motion=X_3)  # -> Geometry, Transform
move_3 = Move(Geometry=split_2.ListB, Motion=X)  # -> Geometry, Transform
merge = Merge(Data1=flatten(move.Geometry), Data2=flatten(move_2.Geometry), Data3=flatten(move_3.Geometry))
end = EndPoints(Curve=geo)  # -> Start, End
ln = Line(StartPoint=end.Start, EndPoint=end.End)
nurbcrv = NurbsCurve(Points=merge, Weights=cp.Weights, Knots=cp.Knots)  # -> Curve, Length, Domain
revsrf = Revolution(Curve=nurbcrv.Curve, Axis=ln, Domain=Domain(0, 6.283185307))
cap = CapHoles(Brep=revsrf)
volume = Volume(Geometry=cap)  # -> Volume, Centroid
area = Area(Geometry=cap)  # -> Area, Centroid
division = Division(A=area.Area, B=volume.Volume)
