# Grasshopper definition bridge.gh (Grasshopper 1.0.7)
# plug-ins: Discover, karambaGH

# ---- group: Discover
discover = Discover(Connect=Button())  # -> Status, Active
categorical = Categorical(Number="4", Count="5", Active=discover.Active)  # -> Status, Values
continuous = Continuous(Range="4", Count="6", Active=discover.Active)  # -> Status, Values
screenshot = CaptureScreenshot(ViewName="Right", Active=discover.Active)

# ----
pt = ConstructPoint(XCoordinate=0, YCoordinate=0, ZCoordinate=0)
Y = UnitY(Factor=1)
line = LineSDL(Start=pt, Direction=Y, Length=Slider(10, range=0..10))
divide = DivideCurve(Curve=line, Count=Slider(5, range=0..10), Kinks=False)  # -> Points, Tangents, Parameters
Z = UnitZ(Factor=continuous.Values)
move = Move(Geometry=divide.Points, Motion=Z)  # -> Geometry, Transform
python = PythonScript(pts1=divide.Points, pts2=move.Geometry, types=categorical.Values)  # -> out, lines; inputs pts1: list, pts2: list, types: list
# ---------- python: Python ----------
import rhinoscriptsyntax as rs

lines = []

for i, type in enumerate(types):
    if type == 1:
        lines.append(rs.AddLine(pts1[i], pts2[i+1]))
    if type == 2:
        lines.append(rs.AddLine(pts2[i], pts1[i+1]))
    if type == 3:
        lines.append(rs.AddLine(pts1[i], pts2[i+1]))
        lines.append(rs.AddLine(pts2[i], pts1[i+1]))
# ---------- end python ----------
pline = PolyLine(Vertices=divide.Points, Closed=False)
pline_2 = PolyLine(Vertices=move.Geometry, Closed=False)
ln = Line(StartPoint=divide.Points, EndPoint=move.Geometry)
end = EndPoints(Curve=line)  # -> Start, End
explode = Explode(Curve=pline, Recursive=True)  # -> Segments, Vertices
explode_2 = Explode(Curve=pline_2, Recursive=True)  # -> Segments, Vertices
merge = Merge(Data1=end.Start, Data2=end.End)  # -> flatten(Result)
number_slider = Slider(15, range=0..100)
merge_2 = Merge(Data1=ln, Data2=explode_2.Segments, Data3=python.lines)  # -> flatten(Result)
Z_2 = UnitZ(Factor=Slider(10, range=0..10))
rev = Reverse(Vector=Z_2)
division = Division(A=number_slider, B="4")
supp = SupportKaramba(PosInd=merge, menu=[buttons(on, on, on, on, on, off)])
cross_section = CrossSectionKaramba3D(
    FamilyNameOfCrossSection="DefaultCroSec",
    ElementIdentifier="structure",
    Diameter_cm=number_slider,
    WallThickness_cm=division,
    mode="Circular Hollow")
linetobeam = LineToBeamKaramba(Line=merge_2, New=True, Remove=True, LimitDistance_m=0.005, BeamIdentifier="structure")  # -> Points, Element, Info
linetobeam_2 = LineToBeamKaramba(Line=explode.Segments, New=True, Remove=True, LimitDistance_m=0.005, BeamIdentifier="road")  # -> Points, Element, Info
loads = LoadsKaramba(Vector=rev, BeamIdentifierS="road", LCase=0, mode="Uniform Line", menu=[buttons(off, on, off)])
merge_3 = Merge(Data1=linetobeam_2.Element, Data2=linetobeam.Element)  # -> flatten(Result)
range = Range(Domain=Domain(0, 1), Steps=10)
gradient = Gradient(
    LowerLimit=0,
    UpperLimit=1,
    Parameter=range,
    stops=[0.253: RGB(255, 0, 0), 0.497: RGB(99, 154, 199), 0.751: RGB(255, 0, 0)])
assemble = AssembleModelKaramba(Elem=merge_3, Support=supp, Load=loads, CrossSection=cross_section, LimitDistance_m=0.005)  # -> Model, Info, Mass_kg, CenterOfGravity
analyzethi = AnalyzeThIKaramba(Model=assemble.Model)  # -> CalculatedModel, MaximumDisplacement_m, ResultingForceOfGravity_kN, ElasticEnergy_kNm
modelview = ModelViewKaramba(
    Model=analyzethi.CalculatedModel,
    LoadCaseFactorsForLinearSuperposition=1,
    IndexIncrementOfVisibleLoadcase=0,
    ListOfColorsForColoringPlots=gradient)  # -> Model, DeformedMesh, DeformedAxes, DeformedModel
beamview = BeamViewKaramba(Model=modelview.Model)  # -> Model, MeshesOfRenderedBeams, DeformedBeamAxes, LegendColors, LegendTags
python_2 = PythonScript(x=beamview.LegendTags)  # -> out, a; inputs x: list
# ---------- python_2: Python ----------
import re

a = []

x.pop(0)

for val in x:
    try:
        a.append( float(re.sub(r'[^\d.-e+]+', '', val)) )
    except ValueError:
        continue
# ---------- end python_2 ----------
abs = Absolute(Value=python_2.a)
bnd = Bounds(Numbers=abs)
dedomain = DeconstructDomain(Domain=bnd)  # -> Start, End
material_min = Panel(assemble.Mass_kg)
displacement_min = Panel(analyzethi.MaximumDisplacement_m)
max_utilization_percentage = Panel(dedomain.End)
objective = Objective(Name="Material", Value=material_min, Goal="Minimize")
constraint = Constraint(Name="Utilization", Target="50", Value=max_utilization_percentage, Goal="Less than")
objective_2 = Objective(Name="Displacement", Value=displacement_min, Goal="Minimize")
