# Grasshopper definition circle-pack.gh (Grasshopper 1.0.7)
# plug-ins: Discover, Human

discover = Discover(Connect=Button())  # -> Status, Active
continuous = Continuous(Range="10", Count="4", Active=discover.Active)  # -> Status, Values
continuous_2 = Continuous(Range="20", Count="4", Active=discover.Active)  # -> Status, Values
continuous_3 = Continuous(Range="10", Count="4", Active=discover.Active)  # -> Status, Values
screenshot = CaptureScreenshot(ViewName="Top", Active=discover.Active)
pt = ConstructPoint(XCoordinate=continuous.Values, YCoordinate=continuous_2.Values, ZCoordinate=0)
circle = CircleCNR(Center=pt, Normal=Vector(0, 0, 1), Radius=continuous_3.Values)
rectangle = Rectangle(Plane=PlaneXY(0, 0, 0), XSize="10", YSize="20", Radius=0)  # -> Rectangle, Length
runion = RegionUnion(Curves=circle)
boundary = BoundarySurfaces(Edges=circle)
previewlw = CustomPreviewLineweights(Geometry=rectangle.Rectangle, Shader=ColourSwatch(SwatchColor=RGB(0, 0, 0)), Thickness="2", Absolute=False)
rint = RegionIntersection(CurvesA=runion, CurvesB=rectangle.Rectangle)
previewlw_2 = CustomPreviewLineweights(Geometry=runion, Shader=ColourSwatch(SwatchColor=RGB(0, 0, 0)), Thickness="4", Absolute=False)
area = Area(Geometry=runion)  # -> Area, Centroid
area_2 = Area(Geometry=circle)  # -> Area, Centroid
ma = MassAddition(Input=area.Area)  # -> Result, PartialResults
ma_2 = MassAddition(Input=area_2.Area)  # -> Result, PartialResults
area_3 = Area(Geometry=rint)  # -> Area, Centroid
previewlw_3 = CustomPreviewLineweights(Geometry=rint, Shader=ColourSwatch(SwatchColor=RGB(0, 0, 0)), Thickness="4", Absolute=False)
ma_3 = MassAddition(Input=area_3.Area)  # -> Result, PartialResults
subtraction = Subtraction(A=ma_2.Result, B=ma.Result)
subtraction_2 = Subtraction(A=ma_2.Result, B=ma_3.Result)
addition = Addition(A=subtraction, B=subtraction_2)
sqr = Square(Value=addition)
subtraction_3 = Subtraction(A=ma_3.Result, B=sqr)
objective = Objective(Name="Area", Value=subtraction_3, Goal="Maximize")
