# Grasshopper definition grid.gh (Grasshopper 1.0.7)
# plug-ins: Discover

# ---- group: Discover
discover = Discover(Connect=Button())  # -> Status, Active
categorical = Categorical(Number="3", Count="25", Active=discover.Active)  # -> Status, Values
screenshot = CaptureScreenshot(ViewName="Top", Active=discover.Active)

# ----
number_slider = Slider(5, range=0..10)
int = Integer(categorical.Values)
series = Series(Start=0, Step=1, Count=number_slider)
bnd = Bounds(Numbers=flatten(int))
pt = ConstructPoint(XCoordinate=0, YCoordinate=0, ZCoordinate=0)
X = UnitX(Factor=series)
Y = UnitY(Factor=series)
move = Move(Geometry=pt, Motion=X)  # -> Geometry, Transform
gradient = Gradient(
    LowerLimit=0,
    UpperLimit=bnd,
    Parameter=int,
    stops=[0: RGB(234, 38, 0), 0.25: RGB(234, 126, 0), 0.5: RGB(254, 244, 84), 0.75: RGB(173, 203, 249), 1: RGB(75, 107, 169)])
division = Division(A=number_slider, B=Slider(2.5, range=0..10))
move_2 = Move(Geometry=graft(move.Geometry), Motion=Y)  # -> flatten(Geometry), Transform
pt_2 = ConstructPoint(XCoordinate=division, YCoordinate=division, ZCoordinate=0)
dist = Distance(PointA=move_2.Geometry, PointB=pt_2)
dots = DotDisplay(Point=move_2.Geometry, Colour=gradient, Size=Slider(0.4, range=0..1))
subtraction = Subtraction(A=int, B=dist)
abs = Absolute(Value=subtraction)
ma = MassAddition(Input=abs)  # -> Result, PartialResults
objective = Objective(Name="Score", Value=ma.Result, Goal="Minimize")
