# Grasshopper definition hill.gh (Grasshopper 1.0.7)
# plug-ins: Discover

# ---- group: Discover
discover = Discover(Connect=Button())  # -> Status, Active
continuous = Continuous(Range="10", Count="2", Active=discover.Active)  # -> Status, Values
screenshot = CaptureScreenshot(ViewName="Perspective", Active=discover.Active)

# ----
bang = ExplodeTree(Data=simplify(graft(continuous.Values)))  # -> Branch0, Branch1
pt = ConstructPoint(XCoordinate=bang.Branch0, YCoordinate=bang.Branch1, ZCoordinate=0)
Z = UnitZ(Factor=1)
geo = Geometry(<brep referenced from the Rhino model>)
project = ProjectPoint(Point=pt, Direction=Z, Geometry=geo)  # -> Point, Index
pdecon = Deconstruct(Point=project.Point)  # -> XComponent, YComponent, ZComponent

# ---- group: Discover
objective = Objective(Name="Height", Value=pdecon.ZComponent, Goal="Maximize")

# ----
dots = DotDisplay(Point=project.Point, Colour=ColourSwatch(SwatchColor=RGB(255, 0, 0)), Size=Slider(0.25, range=0..1))
