# Grasshopper definition pill.gh (Grasshopper 1.0.7)
# plug-ins: Discover

# ---- group: Discover
discover = Discover(Connect=Button())  # -> Status, Active
continuous = Continuous(Range="5", Count="3", Active=discover.Active)  # -> Status, Values
screenshot = CaptureScreenshot(ViewName="Perspective", Active=discover.Active)

# ----
bang = ExplodeTree(Data=simplify(graft(continuous.Values)))  # -> Branch0, Branch1, Branch2
geo = Geometry(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)
cp = ControlPoints(Curve=geo)  # -> Points, Weights, Knots
X = UnitX(Factor=bang.Branch0)
X_2 = UnitX(Factor=bang.Branch1)
X_3 = UnitX(Factor=bang.Branch2)
split = SplitList(List=cp.Points, Index=Slider(1, range=0..1))  # -> ListA, ListB
split_2 = SplitList(List=split.ListB, Index=Slider(3, range=0..10))  # -> ListA, ListB
move = Move(Geometry=split.ListA, Motion=X)  # -> Geometry, Transform
move_2 = Move(Geometry=split_2.ListA, Motion=X_2)  # -> Geometry, Transform
move_3 = Move(Geometry=split_2.ListB, Motion=X_3)  # -> Geometry, Transform
merge = Merge(Data1=flatten(move.Geometry), Data2=flatten(move_2.Geometry), Data3=flatten(move_3.Geometry))
end = EndPoints(Curve=geo)  # -> Start, End
nurbcrv = NurbsCurve(Points=merge, Weights=cp.Weights, Knots=cp.Knots)  # -> Curve, Length, Domain
ln = Line(StartPoint=end.Start, EndPoint=end.End)
revsrf = Revolution(Curve=nurbcrv.Curve, Axis=ln, Domain=Domain(0, 6.283185307))
cap = CapHoles(Brep=revsrf)
area = Area(Geometry=cap)  # -> Area, Centroid
volume = Volume(Geometry=cap)  # -> Volume, Centroid

# ---- group: Discover
objective = Objective(Name="Surface Area", Value=area.Area, Goal="Minimize")
objective_2 = Objective(Name="Volume", Value=volume.Volume, Goal="Maximize")
