# Grasshopper definition salesman.gh (Grasshopper 1.0.7)
# plug-ins: Discover, Human

# ---- group: Discover
discover = Discover(Connect=Button())  # -> Status, Active
sequence = Sequence(Number="10", Message=discover.Active)  # -> Status, Values
screenshot = CaptureScreenshot(ViewName="Top", Message=discover.Active)

# ----
pipeline = GeometryPipeline(
    GroupByLayer=False,
    GroupByType=False,
    IncludeHidden=True,
    IncludeLocked=True,
    LayerFilter="start",
    NameFilter="*",
    SublayerFiltering=True,
    TypeFilter=1)
pipeline_2 = GeometryPipeline(
    GroupByLayer=False,
    GroupByType=False,
    IncludeHidden=True,
    IncludeLocked=True,
    LayerFilter="cities",
    NameFilter="*",
    SublayerFiltering=True,
    TypeFilter=1)
item = ListItem(List=pipeline_2, Index=sequence.Values, Wrap=True)
merge = Merge(Data1=flatten(pipeline), Data2=flatten(item))
pline = PolyLine(Vertices=merge, Closed=True)
previewlw = CustomPreviewLineweights(Geometry=pline, Shader=ColourSwatch(SwatchColor=RGB(255, 0, 0)), Thickness=Slider(2, range=0..10))
len = Length(Curve=pline)
objective = Objective(Name="Length", Value=len, Goal="Minimize")
